# Grasshopper definition flockingTest.gh (Grasshopper 0.9.75)
# plug-ins: Agent

number_slider = Slider(10000, range=0..10000)
planesrf = PlaneSurface(Plane=PlaneXY(0, 0, 0), XSize=Domain(-10, 10), YSize=Domain(-10, 10))
particle = ConstructParticle(
    MinimumInitialVelocity=Vector(-0.1, -0.1, -0.1),
    MaximumInitialVelocity=Vector(0.1, 0.1, 0.1),
    Acceleration=Vector(0, 0, 0),
    Lifespan=30,
    Mass=1,
    BodySize=1,
    HistoryLength=1)
agent = ConstructAgent(Particle=particle, MaxSpeed=0.5, MaxForce=0.1, VisionRadius=5, VisionAngle=360)
ptemit = PointEmitter(ContinuousFlow=Toggle(False), CreationRate=1, NumberOfQuelea=Slider(1000, range=0..1000), Point=Point(0, 0, 0))
srfenv = SurfaceEnvironment(Surface=planesrf)  # -> Environment, _2DReferenceSurface
number_slider_2 = Slider(3, range=0..10)  # disabled
system = System(Quelea=agent, Emitters=ptemit)  # -> System, Quelea, QueleaNetwork
timer = Timer(TimerInterval=20, Target=[engine, system])  # disabled
engine = Engine(Reset=Toggle(True), System=system.System)
neighbors = GetNeighborsInRadius(Agent=system.Quelea, QueleaNetwork=system.QueleaNetwork, VisionRadius=5, VisionAngle=360)  # disabled
neighbors_2 = GetNeighborsInRadius(Agent=system.Quelea, QueleaNetwork=neighbors, VisionRadius=number_slider_2, VisionAngle=360)  # disabled
departicle = DeconstructParticle(Particle=system.Quelea)  # -> Position, Velocity, Acceleration, Lifespan, Mass, BodySize, SurfacePosition, SurfaceVelocity, SurfaceAcceleration
item = ListItem(List=departicle.Position, Index=0, Wrap=True)  # -> flatten(Item)
cohese = CoheseForce(Apply=True, Agent=system.Quelea, WeightMultiplier=1, GetNeighborsInRadius=neighbors)  # disabled
separate = SeparateForce(Apply=True, Agent=system.Quelea, WeightMultiplier=1, GetNeighborsInRadius=neighbors_2)  # disabled
